# Grasshopper definition FindMeshLocalLowestPoints.gh (Grasshopper 0.9.76)
# plug-ins: Python Interpreter

number_slider = Slider(100, range=0..100)

# ---- group: Build Mesh
curve = Curve([<curve referenced from the Rhino model> x13])
patch = Patch(Curves=curve, Spans=20, Flexibility=1, Trim=True)
mesh_surface = MeshSurface(Surface=patch, UCount=number_slider, VCount=number_slider, Overhang=True, Equalize=False)

# ---- group: Find Lowest Points
# Currently only can deal with same U,V value, I will work on it later.
python_script = PythonScript(Mesh=mesh_surface)  # -> out, a
# ---------- python_script: Python ----------
import rhinoscriptsyntax as rs
import math
Vertices = rs.MeshVertices(Mesh) # Get Mesh Vertices
#Get Mesh UV value 
uvValue = int(math.sqrt(len(Vertices)))


pList = []
#BlackList is storing the points that we don't want at the edge
BlackList = []
for k in range(uvValue):
    BlackList.append(k*uvValue)
    BlackList.append(k*uvValue - 1)
    
print BlackList


for i in range(0,len(Vertices)):
#for each point, check if it is the lowest of its neighbours
    if (i not in BlackList) and (i >= uvValue) and (i < len(Vertices) - uvValue) and (Vertices[i][2] < Vertices[i+1][2]) and (Vertices[i][2] < Vertices[i-1][2])and (Vertices[i][2] < Vertices[i+uvValue][2])and (Vertices[i][2] < Vertices[i-uvValue][2])and (Vertices[i][2] < Vertices[i-1-uvValue][2])and (Vertices[i][2] < Vertices[i+1-uvValue][2])and (Vertices[i][2] < Vertices[i-1+uvValue][2])and (Vertices[i][2] < Vertices[i+1+uvValue][2]):
        pList.append(Vertices[i])

a = pList
# ---------- end python_script ----------
